# Grasshopper definition 0_KPI_Comparison.gh (Grasshopper 1.0.7)

# ----
# 0_KPI_Comparison
weather_station = ValueList({"BAUDUCCHI": "EPW/AvMY_BAUDUCCHI.epw", "CASELLE": "EPW/AvMY_CASELLE.epw", "ALENIA": "EPW/AvMY_TORINOALENIA.epw", "GIARDINI REALI": "EPW/AvMY_TORINOGIARDINIREALI.epw", "REISS ROMOLI": "EPW/AvMY_TORINOREISSROMOLI.epw", "VIA DELLA CONSOLATA": "EPW/AvMY_TORINOVIADELLACONSOLATA.epw"}, selected="CASELLE")
weather_station_2 = ValueList({"BAUDUCCHI": "EPW/AvMY_BAUDUCCHI.epw", "CASELLE": "EPW/AvMY_CASELLE.epw", "ALENIA": "EPW/AvMY_TORINOALENIA.epw", "GIARDINI REALI": "EPW/AvMY_TORINOGIARDINIREALI.epw", "REISS ROMOLI": "EPW/AvMY_TORINOREISSROMOLI.epw", "VIA DELLA CONSOLATA": "EPW/AvMY_TORINOVIADELLACONSOLATA.epw"}, selected="BAUDUCCHI")
panel = Panel("https://climate.onebuilding.org/WMO_Region_6_Europe/ITA_Italy/PM_Piedmont/ITA_PM_Torino.AF.160595_TMYx.zip")
merge = Merge(Data1=weather_station)
file_path = FilePath("D:\_PRIN2023\UWG\Workshop\")
downloadepw = LBDownloadWeather(weather_URL=panel)  # -> epw_file, stat_file, ddy_file; plug-in component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
concatenate = Concatenate(FragmentA=file_path, FragmentB=merge)
importepw = LBImportEPW(epw_file=concatenate)  # -> location, dry_bulb_temperature, dew_point_temperature, relative_humidity, wind_speed, wind_direction, direct_normal_rad, diffuse_horizontal_rad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; plug-in component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
xdata = LBDeconstructData(data=importepw.dry_bulb_temperature)  # -> header, values; plug-in component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

# ----
# Hourly
# Monthly
# Plot
number_slider = Slider(100, range=0..1000)
legendpar = LBLegendParameters(min=Slider(1, range=0..1), max=number_slider)  # -> leg_par; plug-in component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
hourlyplot = LBHourlyPlot(data=importepw.relative_humidity)  # -> out, mesh, legend, borders, labels, title, vis_set; plug-in component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
monthlychart = LBMonthlyChart(data=importepw.relative_humidity)  # -> out, data_mesh, data_lines, col_lines, legend, borders, labels, y_title, title, vis_set; plug-in component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

# ----
# CDD-CDH
# HDD-HDH
hdh_threshold = Slider(18, range=18..24)
cdh_threshold = Slider(24, range=20..26)
xdh = GhPythonScript(temperature=xdata.values, T_heating=hdh_threshold, T_cooling=cdh_threshold)  # -> HDH, CDH, HDD, CDD, HDD_euro, CDD_euro; inputs temperature: list
# ---------- xdh: Python ----------
__author__ = "remotoB"
__version__ = "2025.05.16"

import rhinoscriptsyntax as rs

HDH = []
CDH = []
CDD_euro = []
HDD_euro = []

day_avg = [sum(temperature[i:i+24]) / 24 for i in range(0, len(temperature), 24)]

for T in temperature:
    HDH.append(max(T_heating-T,0))
    CDH.append(max(T-T_cooling,0))

for T in day_avg:
    if T>24:
        CDD_euro.append(T-21)
    else:
        CDD_euro.append(0)
    if T<15:
        HDD_euro.append(18-T)
    else:
        HDD_euro.append(0)

CDD_euro = sum(CDD_euro)
HDD_euro = sum(HDD_euro)
HDD = sum(HDH)/24
CDD = sum(CDH)/24
# ---------- end xdh ----------
panel_2 = Panel(xdh.CDH)
panel_3 = Panel(xdh.HDD)
panel_4 = Panel(xdh.CDD)
panel_5 = Panel(xdh.HDH)

# ----
# Psychrometric
# Chart
number_slider_2 = Slider(1, range=0..1)
legendpar_2 = LBLegendParameters(min=number_slider_2, max=Slider(100, range=0..1000))  # -> leg_par; plug-in component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
dom = ConstructDomain(DomainStart=Slider(-10, range=-10..0), DomainEnd=Slider(40, range=0..100))
psychrometricchart = LBPsychrometricChart(temperature=importepw.dry_bulb_temperature, rel_humidity=importepw.relative_humidity)  # -> out, title, temp_lines, rh_lines, hr_lines, enth_wb_lines, mesh, legend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; plug-in component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
visset = LBPreviewVisualizationSet(vis_set=flatten(psychrometricchart.vis_set))  # -> vs; plug-in component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

# ---- group: CCP
ccp = GhPythonScript(temperatures=xdata.values)  # -> CCP; inputs temperatures: list
# ---------- ccp: Python ----------
__author__ = "remotoB"
__version__ = "2025.05.16"

import rhinoscriptsyntax as rs
import math
t_base_hourly = [24.5 + 2.5 * math.cos(math.pi/12 * (h - 19)) - 3.0 for h in range(24)]

dists = [t_base_hourly[i % 24] - Te for i, Te in enumerate(temperatures)]
CCP = [dist if dist >= 2 else 0 for dist in dists]
# ---------- end ccp ----------
ma = MassAddition(Input=ccp)  # -> Result, PartialResults
panel_6 = Panel(ma.Result)
panel_7 = Panel(ccp)

# ---- group: CCPd
partition = PartitionList(List=ccp, Size="24")  # -> simplify(Chunks)
ma_2 = MassAddition(Input=partition)  # -> Result, PartialResults
panel_8 = Panel("""31
28
31
30
31
30
31
31
30
31
30
31""")
partition_2 = PartitionList(List=flatten(ma_2.Result), Size=panel_8)  # -> simplify(Chunks)
shift = ShiftList(List=panel_8, Shift=-1, Wrap=True)
panel_9 = Panel("""2
3
4""")
panel_10 = Panel("""11
0
1""")
panel_11 = Panel("""5
6
7""")
panel_12 = Panel("""8
9
10""")
partition_3 = PartitionList(List=flatten(shift), Size=3)  # -> simplify(Chunks)
branch = TreeBranch(Tree=partition_2, Path=panel_10, MaintainPaths=True)
branch_2 = TreeBranch(Tree=partition_2, Path=panel_9, MaintainPaths=True)
branch_3 = TreeBranch(Tree=partition_2, Path=panel_11, MaintainPaths=True)
branch_4 = TreeBranch(Tree=partition_2, Path=panel_12, MaintainPaths=True)
ma_3 = MassAddition(Input=flatten(branch))  # -> Result, PartialResults
ma_4 = MassAddition(Input=flatten(branch_2))  # -> Result, PartialResults
ma_5 = MassAddition(Input=flatten(branch_3))  # -> Result, PartialResults
ma_6 = MassAddition(Input=flatten(branch_4))  # -> Result, PartialResults
ma_7 = MassAddition(Input=partition_3)  # -> Result, PartialResults
division = Division(A=simplify(graft([ma_3.Result, ma_4.Result, ma_5.Result, ma_6.Result])), B=ma_7.Result)  # -> flatten(Result)
panel_13 = Panel(division)
panel_14 = Panel("""Dec-Jan-Feb
Mar-Apr-May
Jun-Jul-Aug
Sep-Oct-Nov""")

# ----
# plot
# monthly
# CCPd
panel_15 = Panel("CCPd")
constrtype = LBConstructDataType(name=panel_15, unit="C")  # -> type; plug-in component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
constrheader = LBConstructHeader(data_type=constrtype)  # -> header; plug-in component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
ma_8 = MassAddition(Input=partition_2)  # -> Result, PartialResults
data = LBConstructData(header=constrheader, values=flatten(ma_8.Result), interval="monthly")  # -> data; plug-in component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
pt = Point(Point(164, -108, 0))
monthlychart_2 = LBMonthlyChart(data=data, base_pt=pt)  # -> out, data_mesh, data_lines, col_lines, legend, borders, labels, y_title, title, vis_set; plug-in component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
