# Grasshopper definition 1_Digital_Twin.gh (Grasshopper 1.0.7)
# plug-ins: Urbano, LadybugGrasshopper

boundary_curve = Curve(<curve referenced from the Rhino model>)
main_directory = FilePath("D:\_PRIN2023\UWG\Workshop\")

# ----
# 1. DIGITAL TWIN
# Site boundary
# Main directory
lb_falsestarttoggle = LBFalseStartToggle(False)
curve = Curve(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)
concatenate = Concatenate(
    FragmentA=main_directory,
    FragmentB=["SHP\building.shp", "SHP\green_areas.shp", "SHP\pedestrian.shp", "SHP\street.shp", "SHP\alberate_geo.shp"])
ghpython_script = GhPythonScript(corner_1="45.064110269770694, 7.67117226835887", corner_2="45.0416271564113, 7.691899924820735")  # -> Left, Right, Top, Bottom
# ---------- ghpython_script: Python ----------
__author__ = "remotoB"
__version__ = "2025.02.20"

import rhinoscriptsyntax as rs

lat1 = float(corner_1.split(',')[0])
lon1 = float(corner_1.split(',')[1])
lat2 = float(corner_2.split(',')[0])
lon2 = float(corner_2.split(',')[1])

Top = max(lat1, lat2)
Bottom = min(lat1, lat2)
Left = min(lon1, lon2)
Right = max(lon1, lon2)
# ---------- end ghpython_script ----------
list_item = ListItem(List=concatenate, Index=0, Wrap=True)  # -> Item, Item1, Item2, Item3, Item4
ghpython_script_2 = GhPythonScript(x=curve, y=boundary_curve, run=lb_falsestarttoggle)  # -> a
# ---------- ghpython_script_2: Python ----------
__author__ = "remotoB"
__version__ = "2025.03.12"

import rhinoscriptsyntax as rs

if _run:
    a = y
else:
    a = x
# ---------- end ghpython_script_2 ----------

# ---- group: BUILDINGS
vector = Vector(Vector(-397758.69, -4990741.22, 0))
import_shapefile_features = ImportShapefileFeatures(
    ShapefilePath=list_item.Item,
    Reproject=True,
    UTMZone="32T",
    TranslationVector=vector,
    LeftBound=ghpython_script.Left,
    RightBound=ghpython_script.Right,
    TopBound=ghpython_script.Top,
    BottomBound=ghpython_script.Bottom,
    CroppingGeometry=ghpython_script_2)  # -> Points, Metadata, UTMZone, TranslationVector
deconstruct_metadata = DeconstructMetadata(Metadata=import_shapefile_features.Metadata)  # -> Keys, Values
polyline = PolyLine(Vertices=import_shapefile_features.Points, Closed=False)  # -> flatten(Polyline)
list_item_2 = ListItem(List=deconstruct_metadata.Values, Index=2, Wrap=True)  # -> flatten(Item)
list_item_3 = ListItem(List=deconstruct_metadata.Values, Index=6, Wrap=True)  # -> flatten(Item)
height_and_color = GhPythonScript(area=list_item_2, x=list_item_3)  # -> height, color
# ---------- height_and_color: Python ----------
__author__ = "remotoB"
__version__ = "2024.12.11"

import rhinoscriptsyntax as rs

if x:
    height = x
    color = '200,200,255'
else:
    if float(area) > 50:
        color = '255,0,0'
        height = 15
    elif float(area) < 50:
        height = 3
        color = '0,255,255'
    else:
        height = 1000
# ---------- end height_and_color ----------
vector_xyz = VectorXYZ(XComponent=0, YComponent=0, ZComponent=height_and_color.height)  # -> Vector, Length
extrude = Extrude(Base=polyline, Direction=vector_xyz.Vector)
cap_holes = CapHoles(Brep=extrude)
custom_preview = CustomPreview(Geometry=cap_holes, Material=height_and_color.color)

# ---- group: VEGETATION
vector_2 = Vector(Vector(-397758.69, -4990741.22, 0))
import_shapefile_features_2 = ImportShapefileFeatures(
    ShapefilePath=list_item.Item1,
    Reproject=False,
    UTMZone="32T",
    TranslationVector=vector_2,
    LeftBound=ghpython_script.Left,
    RightBound=ghpython_script.Right,
    TopBound=ghpython_script.Top,
    BottomBound=ghpython_script.Bottom,
    CroppingGeometry=ghpython_script_2)  # -> Points, Metadata, UTMZone, TranslationVector
polyline_2 = PolyLine(Vertices=import_shapefile_features_2.Points, Closed=True)  # -> flatten(Polyline)
boundary_surfaces = BoundarySurfaces(Edges=polyline_2)
custom_preview_2 = CustomPreview(Geometry=boundary_surfaces, Material="0,255,0")

# ---- group: TREES
vector_3 = Vector(Vector(-397758.69, -4990741.22, 0))
import_shapefile_features_3 = ImportShapefileFeatures(
    ShapefilePath=list_item.Item4,
    Reproject=True,
    UTMZone="32T",
    TranslationVector=vector_3,
    LeftBound=ghpython_script.Left,
    RightBound=ghpython_script.Right,
    TopBound=ghpython_script.Top,
    BottomBound=ghpython_script.Bottom,
    CroppingGeometry=ghpython_script_2)  # -> Points, Metadata, UTMZone, TranslationVector
deconstruct_metadata_2 = DeconstructMetadata(Metadata=import_shapefile_features_3.Metadata)  # -> Keys, Values
list_item_4 = ListItem(List=deconstruct_metadata_2.Values, Index=11, Wrap=True)  # -> flatten(Item), flatten(Item1)
trees_radius = GhPythonScript(x=list_item_4.Item1)  # -> out, a
# ---------- trees_radius: Python ----------
__author__ = "remotoB"
__version__ = "2024.12.16"

import rhinoscriptsyntax as rs

if x:
    a = float(x)/2
else:
    a = 3
# ---------- end trees_radius ----------
trees_height = GhPythonScript(x=list_item_4.Item)  # -> out, a
# ---------- trees_height: Python ----------
__author__ = "remotoB"
__version__ = "2024.12.16"

import rhinoscriptsyntax as rs

if x:
    a = x
else:
    a = 5
# ---------- end trees_height ----------
circle_cnr = CircleCNR(Center=flatten(import_shapefile_features_3.Points), Normal=Vector(0, 0, 1), Radius=trees_radius.a)
vector_xyz_2 = VectorXYZ(XComponent=0, YComponent=0, ZComponent=trees_height.a)  # -> Vector, Length
boundary_surfaces_2 = BoundarySurfaces(Edges=circle_cnr)
move = Move(Geometry=flatten(boundary_surfaces_2), Motion=vector_xyz_2.Vector)  # -> Geometry, Transform
custom_preview_3 = CustomPreview(Geometry=move.Geometry, Material="30,100,0")

# ---- group: STREET
vector_4 = Vector(Vector(-397758.69, -4990741.22, 0))
import_shapefile_features_4 = ImportShapefileFeatures(
    ShapefilePath=list_item.Item3,
    Reproject=True,
    UTMZone="32T",
    TranslationVector=vector_4,
    LeftBound=ghpython_script.Left,
    RightBound=ghpython_script.Right,
    TopBound=ghpython_script.Top,
    BottomBound=ghpython_script.Bottom,
    CroppingGeometry=ghpython_script_2)  # -> Points, Metadata, UTMZone, TranslationVector
polyline_3 = PolyLine(Vertices=import_shapefile_features_4.Points, Closed=False)  # -> flatten(Polyline)
boundary_surfaces_3 = BoundarySurfaces(Edges=polyline_3)
custom_preview_4 = CustomPreview(Geometry=boundary_surfaces_3, Material="110,110,110")

# ---- group: PEDESTRIAN
vector_5 = Vector(Vector(-397758.69, -4990741.22, 0))
import_shapefile_features_5 = ImportShapefileFeatures(
    ShapefilePath=list_item.Item2,
    Reproject=True,
    UTMZone="32T",
    TranslationVector=vector_5,
    LeftBound=ghpython_script.Left,
    RightBound=ghpython_script.Right,
    TopBound=ghpython_script.Top,
    BottomBound=ghpython_script.Bottom,
    CroppingGeometry=ghpython_script_2)  # -> Points, Metadata, UTMZone, TranslationVector
polyline_4 = PolyLine(Vertices=import_shapefile_features_5.Points, Closed=False)  # -> flatten(Polyline)
boundary_surfaces_4 = BoundarySurfaces(Edges=polyline_4)
custom_preview_5 = CustomPreview(Geometry=boundary_surfaces_4, Material="110,110,110")

# ----
import_shapefile_features_6 = ImportShapefileFeatures(
    ShapefilePath=list_item.Item,
    Reproject=True,
    LeftBound=ghpython_script.Left,
    RightBound=ghpython_script.Right,
    TopBound=ghpython_script.Top,
    BottomBound=ghpython_script.Bottom)  # -> Points, Metadata, UTMZone, TranslationVector
polyline_5 = PolyLine(Vertices=import_shapefile_features_6.Points, Closed=False)  # -> flatten(Polyline)
custom_preview_6 = CustomPreview(Geometry=polyline_5, Material=ColourSwatch(SwatchColor=RGB(176, 18, 18)))
