# Grasshopper definition 2_UWG.gh (Grasshopper 1.0.7)
# plug-ins: LadybugGrasshopper

# ---- group: DF buildings
hb_construction_types = HBConstructionTypes({"SteelFramed", "WoodFramed", "Mass", "Metal Building"}, selected="WoodFramed")
# 2_Urban_Weather_Generator
hb_climate_zones = HBClimateZones({"1 - Very Hot": "1", "2 - Hot": "2", "3 - Warm": "3", "4 - Mixed": "4", "5 - Cool": "5", "6 - Cold": "6", "7 - Very Cold": "7", "8 - Subarctic": "8"}, selected="4 - Mixed")
hb_building_programs = HBBuildingPrograms({"LargeOffice", "MediumOffice", "SmallOffice", "MidriseApartment", "HighriseApartment", "Retail", "StripMall", "PrimarySchool", "SecondarySchool", "SmallHotel", "LargeHotel", "Hospital", "Outpatient", "Laboratory", "Warehouse", "SuperMarket", "FullServiceRestaurant", "QuickServiceRestaurant", "Courthouse", "College", "LargeDataCenterHighITE", "LargeDataCenterLowITE", "SmallDataCenterHighITE", "SmallDataCenterLowITE"}, selected="MediumOffice")
constrsetclimate = HBConstructionSetByClimate(climate_zone=hb_climate_zones, constr_type=hb_construction_types)  # -> constr_set; plug-in component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
buildingsolid = DFBuildingFromSolid(floor_to_floor="@4", program=hb_building_programs, constr_set=constrsetclimate, run=True)  # -> out, buildings; plug-in component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
simpleratiopar = DFSimpleWindowRatioParameters(ratio="0.3")  # -> win_par; plug-in component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
applyfacadepar = DFApplyFacadeParameters(df_obj=buildingsolid.buildings, win_par=simpleratiopar)  # -> out, df_obj; plug-in component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

# ----
context = DFContextShade(uwg_is_veg=Toggle(True))  # -> out, context; plug-in component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

object_details = ObjectDetails()  # -> Referenced, Available, Name, Layer, Colour, Guid
model_naming = GhPythonScript(epw_dest=object_details.Name)  # -> model_name
# ---------- model_naming: Python ----------
__author__ = "remotoB"
__version__ = "2025.02.19"

import rhinoscriptsyntax as rs
import os

epw = os.path.basename(epw_org).split('.')[0]
model_name = "UWG_" + str(epw_dest) + '_' + str(epw)
# ---------- end model_naming ----------
model = DFModel(buildings=flatten(applyfacadepar.df_obj), context=flatten(context.context), name=model_naming)  # -> out, model; plug-in component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

# ---- group: GRASS COVER
area = Area()  # -> Area, Centroid
area_2 = Area()  # -> Area, Centroid
mass_addition = MassAddition(Input=area.Area)  # -> Result, PartialResults
mass_addition_2 = MassAddition(Input=area_2.Area)  # -> Result, PartialResults
division = Division(A=mass_addition.Result, B=mass_addition_2.Result)

# ---- group: TRAFFIC
traffic = DFTrafficParameters(watts_per_area=Slider(20, range=0..30))  # -> traffic; plug-in component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

# ----
boundary_surfaces = BoundarySurfaces()
terrain = DFTerrain(terrain_geo=boundary_surfaces)  # -> terrain; plug-in component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

value_list = ValueList({"January": 1, "February": 2, "March": 3, "April": 4, "May": 5, "June": 6, "July": 7, "August": 8, "September": 9, "October": 10, "November": 11, "December": 12}, selected="January")
value_list_2 = ValueList({"January": 1, "February": 2, "March": 3, "April": 4, "May": 5, "June": 6, "July": 7, "August": 8, "September": 9, "October": 10, "November": 11, "December": 12}, selected="December")
analysisperiod = LBAnalysisPeriod(
    start_month=value_list,
    start_day=Slider(1, range=0..1),
    start_hour=0,
    end_month=value_list_2,
    end_day=Slider(31, range=1..31))  # -> period, hoys, dates; plug-in component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
uwgsimpar = DFUWGSimulationParameter(run_period=analysisperiod.period)  # -> sim_par; plug-in component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

modeluwg = DFAssignModelUWGProperties(model=model.model, terrain=terrain, traffic=traffic, grass_cover=division)  # -> out, model; plug-in component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
file_path = FilePath()
cluster = Cluster(fragment_a=file_path)
concatenate = Concatenate(FragmentA=file_path, FragmentB="UWG")
toggle = LBFalseStartToggle(False)
runuwg = DFRunUrbanWeatherGenerator(model=modeluwg.model, epw_file=cluster, sim_par=uwgsimpar, folder=concatenate, write=toggle, run=toggle)  # -> out, uwg_json, urban_epw; plug-in component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
panel = Panel(runuwg.out)

# ==== cluster Cluster

# ---- group: Cluster Input
epw_file = ClusterInput()

# ----
importepw = LBImportEPW(epw_file=epw_file)  # -> location, dry_bulb_temperature, dew_point_temperature, relative_humidity, wind_speed, wind_direction, direct_normal_rad, diffuse_horizontal_rad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; plug-in component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
createepw = DFCreateEPW(
    location=importepw.location,
    dry_bulb_temp=importepw.dry_bulb_temperature,
    dew_point_temp=importepw.dew_point_temperature,
    wind_speed=importepw.wind_speed,
    wind_direction=importepw.wind_direction,
    direct_normal_rad=importepw.direct_normal_rad,
    diffuse_horiz_rad=importepw.diffuse_horizontal_rad,
    horiz_infrared_rad=importepw.horizontal_infrared_rad,
    run=Toggle(True))  # -> out, epw_obj; plug-in component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

# ---- group: Cluster Input
fragment_a = ClusterInput()

# ----
concatenate = Concatenate(FragmentA=fragment_a, FragmentB="temp")
writeepw = DFWriteEPW(epw_obj=createepw.epw_obj, folder=concatenate, run=Toggle(True))  # -> out, epw_file; plug-in component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

# ---- group: Cluster Output
epw_file_2 = ClusterOutput(writeepw.epw_file)
