# Grasshopper definition 3_Energy_Simulation.gh (Grasshopper 1.0.7)
# plug-ins: LadybugGrasshopper

file_path = FilePath("D:\_PRIN2023\UWG\Workshop\")
lb_falsestarttoggle = LBFalseStartToggle(False)
concatenate = Concatenate(FragmentA=file_path, FragmentB="IDF\Medium office EN 16798-1.idf")
loademodel = HBLoadGbXMLOSMIDF(model_file=concatenate, load=lb_falsestarttoggle)  # -> out, model; plug-in component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
deconstructmodel = HBDeconstructModel(model=loademodel.model)  # -> rooms, faces, apertures, doors, shades; plug-in component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
hb_building_programs = HBBuildingPrograms({"LargeOffice", "MediumOffice", "SmallOffice", "MidriseApartment", "HighriseApartment", "Retail", "StripMall", "PrimarySchool", "SecondarySchool", "SmallHotel", "LargeHotel", "Hospital", "Outpatient", "Laboratory", "Warehouse", "SuperMarket", "FullServiceRestaurant", "QuickServiceRestaurant", "Courthouse", "College", "LargeDataCenterHighITE", "LargeDataCenterLowITE", "SmallDataCenterHighITE", "SmallDataCenterLowITE"}, selected="LargeOffice")
number_slider = Slider(25, range=0..100)
number_slider_2 = Slider(26, range=0..100)
number_slider_3 = Slider(20, range=0..100)
number_slider_4 = Slider(60, range=0..100)
applysetpointvals = HBApplySetpointValues(room_or_program=flatten(deconstructmodel.rooms))  # -> out, mod_obj; plug-in component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
conditioned = HBSetConditioned(rooms=applysetpointvals.mod_obj, conditioned=Toggle(True))  # -> rooms; plug-in component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
idealair = HBIdealAir(rooms=flatten(conditioned))  # -> out, rooms; plug-in component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
model = HBModel(
    rooms=flatten(idealair.rooms),
    faces=flatten(deconstructmodel.faces),
    apertures=flatten(deconstructmodel.apertures),
    doors=flatten(deconstructmodel.doors),
    name="test")  # -> out, model; plug-in component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

panel = Panel("D:\_PRIN2023\Weather_files\Hourly_data\Processed\EPW\TMY\TMY_CASELLE_elementsModified.epw")
panel_2 = Panel("D:\_PRIN2023\Weather_files\Hourly_data\Processed\EPW\TMY\TMY_CASELLE.epw")
point = Point(Point(245, -309.1589852, 0))
cluster = Cluster(gate=Slider(4, range=0..100), epw_file=[panel_2, panel], base_pt=point)  # -> out, mesh, legend, borders, labels, title, vis_set
visset = LBPreviewVisualizationSet(vis_set=flatten(cluster.vis_set))  # -> vs; plug-in component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

panel_3 = Panel("""Zone Air Relative Humidity
Zone mean air temperature
zone mean radiant temperature
zone mean relative humidity
Zone Air System Sensible Heating Energy
Zone Air System Sensible cooling Energy
zone operative temperature
Zone Ideal Loads Heating Energy
Zone Ideal Loads Cooling Energy
Zone People Total Heat Gain
Zone Infiltration Sensible Heat Gain Energy
Zone Ideal Loads Supply Air Total Cooling Energy
Zone Ideal Loads Supply Air Sensible Cooling Energy
Zone Ideal Loads Supply Air Total Heating Energy
Zone Ideal Loads Supply Air Sensible Heating Energy
Zone Air System Sensible Cooling Energy
Zone Air System Sensible Heating Energy""")
customoutput = HBCustomSimulationOutput(output_names=panel_3)  # -> out, sim_output; plug-in component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
simpar = HBSimulationParameter(output=customoutput.sim_output, timestep=6)  # -> sim_par; plug-in component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

lb_falsestarttoggle_2 = LBFalseStartToggle(False)
concatenate_2 = Concatenate(FragmentA=file_path, FragmentB="EP_result")
modeltoosm = HBModelToOSM(model=model.model, sim_par=graft(simpar), folder=concatenate_2, write=lb_falsestarttoggle_2, run=lb_falsestarttoggle_2)  # -> out, jsons, osw, osm, idf, sql, zsz, rdd, html; plug-in component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
readrdd = HBReadResultDictionary(rdd=modeltoosm.rdd)  # -> outputs; plug-in component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
customresult = HBReadCustomResult(sql=modeltoosm.sql, output_names=readrdd)  # -> simplify(results); plug-in component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
clean_tree = CleanTree(RemoveNulls=True, RemoveInvalid=True, RemoveEmpty=True, Tree=customresult)

hb_building_programs_2 = HBBuildingPrograms({"LargeOffice", "MediumOffice", "SmallOffice", "MidriseApartment", "HighriseApartment", "Retail", "StripMall", "PrimarySchool", "SecondarySchool", "SmallHotel", "LargeHotel", "Hospital", "Outpatient", "Laboratory", "Warehouse", "SuperMarket", "FullServiceRestaurant", "QuickServiceRestaurant", "Courthouse", "College", "LargeDataCenterHighITE", "LargeDataCenterLowITE", "SmallDataCenterHighITE", "SmallDataCenterLowITE"}, selected="MediumOffice")
applysetpointvals_2 = HBApplySetpointValues(
    room_or_program=flatten(hb_building_programs_2),
    cooling_setpt=Slider(26, range=0..100),
    heating_setpt=Slider(20, range=0..100),
    humid_setpt=Slider(25, range=0..100),
    dehumid_setpt=Slider(60, range=0..100))  # -> out, mod_obj; plug-in component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
brep = Brep(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)
roomsolid = HBRoomFromSolid(geo=flatten(brep), name="try", program=applysetpointvals_2.mod_obj, conditioned=Toggle(True))  # -> out, rooms; plug-in component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
aperturesbyratio = HBAperturesByRatio(hb_objs=flatten(roomsolid.rooms), ratio=Slider(0.3, range=0..1), win_height=Slider(1.5, range=0..10))  # -> out, hb_objs; plug-in component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
idealair_2 = HBIdealAir(rooms=flatten(aperturesbyratio.hb_objs))  # -> out, rooms; plug-in component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
panel_4 = Panel("""caselle
SanSalvario""")
model_2 = HBModel(rooms=flatten(idealair_2.rooms), name=panel_4)  # -> out, model; plug-in component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

# ----
# 3_Energy_Simulation
number_slider_5 = Slider(3, range=0..15)
list_item = ListItem(List=clean_tree, Index=number_slider_5, Wrap=True)
path_mapper = PathMapper(list_item, source="{A;B}", target="{A}")
xdata = LBDeconstructData(data=list_item)  # -> header, values; plug-in component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
bounds = Bounds(Numbers=xdata.values)  # -> simplify(Domain)
list_length = ListLength(List=path_mapper)
deconstruct_domain = DeconstructDomain(Domain=bounds)  # -> Start, End
hourlyplot = LBHourlyPlot(data=clean_tree, x_dim=Slider(0.4, range=0..1))  # -> out, mesh, legend, borders, labels, title, vis_set; plug-in component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
series = Series(Start=0, Step=Slider(200, range=0..1000), Count=list_length)
number_slider_6 = Slider(60, range=0..100)
construct_point = ConstructPoint(XCoordinate=series, YCoordinate=graft([Slider(0, range=0..100), Slider(150, range=0..1000)]), ZCoordinate=0)
legendpar = LBLegendParameters(min=deconstruct_domain.Start, max=deconstruct_domain.End)  # -> leg_par; plug-in component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

# ==== cluster Cluster
epw_file = ClusterInput()
importepw = LBImportEPW(epw_file=epw_file)  # -> location, dry_bulb_temperature, dew_point_temperature, relative_humidity, wind_speed, wind_direction, direct_normal_rad, diffuse_horizontal_rad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; plug-in component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
gate = ClusterInput()
stream_filter = StreamFilter(
    Gate=gate,
    Stream0=importepw.dry_bulb_temperature,
    Stream1=importepw.relative_humidity,
    Stream2=importepw.wind_speed,
    Stream3=importepw.direct_normal_rad,
    Stream4=importepw.global_horizontal_rad)
xdata = LBDeconstructData(data=stream_filter)  # -> header, simplify(values); plug-in component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
tree_branch = TreeBranch(Tree=xdata.values, Path=Slider(0, range=0..100), MaintainPaths=True)
tree_branch_2 = TreeBranch(Tree=xdata.values, Path=Slider(1, range=0..100), MaintainPaths=True)
list_item = ListItem(List=xdata.header, Index=0, Wrap=True)
subtraction = Subtraction(A=tree_branch, B=tree_branch_2)
base_pt = ClusterInput()
data = LBConstructData(header=list_item, values=subtraction)  # -> data; plug-in component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
hourlyplot = LBHourlyPlot(data=data, base_pt=base_pt)  # -> out, mesh, legend, borders, labels, title, vis_set; plug-in component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
out = ClusterOutput(hourlyplot.out)
mesh = ClusterOutput(hourlyplot.mesh)
legend = ClusterOutput(hourlyplot.legend)
vis_set = ClusterOutput(hourlyplot.vis_set)
borders = ClusterOutput(hourlyplot.borders)
labels = ClusterOutput(hourlyplot.labels)
title = ClusterOutput(hourlyplot.title)
